# Grasshopper definition SaveOBJ.gh (Grasshopper 0.9.76)
# plug-ins: MeshEdit Components, LunchBox

path = FilePath("C:\Users\provolot\Documents\GitHub\provolot.github.io\RiftSketch\grasshopper\test.obj")
saveobj = Button()
split = TextSplit(Text=path, Separators="\")
split_2 = SplitList(List=reverse(split), Index="1")  # -> ListA, reverse(ListB)
pipeline = GeometryPipeline(
    GroupByLayer=False,
    GroupByType=False,
    IncludeHidden=True,
    IncludeLocked=True,
    LayerFilter="THREEJS",
    NameFilter="*",
    TypeFilter=32)
join = TextJoin(Text=split_2.ListB, Join="\")
concat = Concatenate(FragmentA="test", FragmentB=".obj")
convquads = MeshConvertQuads(Mesh=pipeline, ShortDiagonal=True)  # -> Mesh, Splitted
tri = Triangulate(Mesh=pipeline)  # -> Mesh, Count
save = ObjectSave(
    BakeToggle=saveobj,
    FileDirectory=join,
    FileName=concat,
    GeometryObjects=convquads.Mesh,
    Layer="GH_Export",
    ObjectName="GH_Obj",
    ObjectColor=RGB(255, 255, 255),
    LayerColor=RGB(255, 255, 255))
